% Simulink data dictionary modelDictionary.sldd

BAK = Simulink.Signal(DataType="double")  % 0.00525
  % 0.012
  % 0.958
  % 0.1827
  % 0.012
  % 0.0525

Motor_Ld_Indctances = 0.002
SysVoltage = 300
Motor_Lq_Indctances = 0.004
Motor_flux = 0.08
Motor_Rs = 0.02
Switch_SubsysCtrl = 5
Motor_Pn = 4
Ts = 1.0e-6
MPTA_SubSysCtrl = 0
switch_electronic_feedworward = 1
DTC_Flux_Predict = 0
MPTA_Way = 1
SysCurrentMax = 50
SysSpeedMax = 2500